# Grasshopper definition rev1-1.gh (Grasshopper 1.0.7)
# plug-ins: Kangaroo2 Components, Shachihoko

半径_最小 = Slider(0.5, range=0..10)
半径_最大 = Slider(1.5, range=0..10)
seed = Slider(4, range=0..1000)
box_size = Slider(10, range=0..10)
box_offset = Slider(1, range=0..10)
数_最小 = Slider(25, range=0..1000)
数_最大 = Slider(50, range=0..1000)
mesh_uv = Slider(25, range=0..100)
construct_domain = ConstructDomain(DomainStart=数_最小, DomainEnd=数_最大)
expression = Expression(BoxSize=box_size, Offset=box_offset, Expression="(BoxSize - Offset) / 2.0")
random = Random(Range=construct_domain, Number=1, Seed=seed)
construct_domain_2 = ConstructDomain(DomainStart=半径_最小, DomainEnd=半径_最大)
division = Division(A=box_size, B=Slider(2, range=0..10))
random_2 = Random(Range=construct_domain_2, Number=random, Seed=seed)
center_box = CenterBox(Base=PlaneXY(0, 0, 0), X=division, Y=division, Z=division)
center_box_2 = CenterBox(Base=PlaneXY(0, 0, 0), X=expression, Y=expression, Z=expression)
populate_3d = Populate3D(Region=center_box, Count=random, Seed=seed)
solidpointcollide = SolidPointCollide(Points=populate_3d, Solid=center_box_2, Interior=Toggle(True), Unidirectional=True, Strength=Slider(2, range=0..10))
spherecollide = SphereCollide(Points=populate_3d, Radius=random_2, Strength=Slider(1, range=0..10))
merge = Merge(Data1=spherecollide, Data2=solidpointcollide)
数_最小_2 = Slider(0, range=0..1000)
数_最大_2 = Slider(1000, range=0..1000)
bouncysolver = BouncySolver(GoalObjects=merge, Reset=Button(), Threshold=1e-15, Tolerance=0.0001, Damping=0.99, Iterations=10, On=Toggle(False))  # -> I, V, O
construct_domain_3 = ConstructDomain(DomainStart=数_最小_2, DomainEnd=数_最大_2)
random_3 = Random(Range=construct_domain_3, Number=Slider(3, range=0..10), Seed=seed)
construct_domain_4 = ConstructDomain(DomainStart=Slider(0, range=0..1), DomainEnd=Slider(1, range=0..1))
mesh_sphere = MeshSphere(Base=bouncysolver.V, Radius=random_2, UCount=mesh_uv, VCount=expr("x*2", mesh_uv))
mesh_box = MeshBox(Base=center_box, XCount=mesh_uv, YCount=mesh_uv, ZCount=mesh_uv)
random_4 = Random(Range=construct_domain_4, Number=random, Seed=random_3)  # -> simplify(Random)
stream_filter = StreamFilter(Gate=Slider(1, range=0..1), Stream1=mesh_sphere)
explode_tree = ExplodeTree(Data=random_4)  # -> Branch0, Branch1, Branch2
clash = Clash(FirstSet=mesh_box, SecondSet=graft(stream_filter), Distance=0, ResultLimit=100)  # -> flatten(ClashCount), ClashPoints, ClashRadii, FirstIndex, SecondIndex
dispatch = Dispatch(List=mesh_sphere, DispatchPattern=clash.ClashCount)  # -> ListA, ListB
materialparam = MaterialParam(
    XComponent=explode_tree.Branch0,
    YComponent=explode_tree.Branch1,
    ZComponent=explode_tree.Branch2,
    WComponent=Slider(0, range=0..1),
    ParamType=0)
materialparam_2 = MaterialParam(
    XComponent=explode_tree.Branch0,
    YComponent=explode_tree.Branch1,
    ZComponent=explode_tree.Branch2,
    WComponent=Slider(0.25, range=0..1),
    ParamType=0)
mesh_intersection = MeshIntersection(MeshesA=mesh_box, MeshesB=dispatch.ListA)
material = Material(Diffuse=materialparam, SpecularGlossiness=materialparam_2, ShaderType=1)
merge_2 = Merge(Data1=dispatch.ListB, Data2=mesh_intersection)
number_slider = Slider(0.25, range=0..1)
number_slider_2 = Slider(1, range=0..1)
colour_rgb_f = ColourRGBF(Alpha=number_slider_2, Red=explode_tree.Branch0, Green=explode_tree.Branch1, Blue=explode_tree.Branch2)
colour_rgb_f_2 = ColourRGBF(Alpha=number_slider_2, Red=number_slider, Green=number_slider, Blue=number_slider)
samevaluetree = SameValueTree(Value=Slider(0.1, range=0..1), BasedTree=colour_rgb_f)
samevaluetree_2 = SameValueTree(Value=Slider(0, range=0..1), BasedTree=colour_rgb_f)
unflatten_tree = UnflattenTree(Tree=material, Guide=flatten(merge_2))  # -> simplify(graft(Tree))
graft_tree = GraftTree(Tree=merge_2, IncludeEmptyLists=True, IncludeNullItems=True)  # -> simplify(graft(Tree))
material_2 = Material(
    Diffuse=colour_rgb_f,
    Specular=colour_rgb_f,
    Ambient=colour_rgb_f_2,
    Transparency=0,
    Reflectivity=samevaluetree,
    Smoothness=samevaluetree_2)  # -> PreviewMaterial, RenderMaterial
export = Export(Mesh=graft_tree, Material=unflatten_tree, FolderPath="D:\デスクトップ", FileName="model", Switch=Toggle(False))
brep_wireframe = BrepWireframe(Brep=center_box, Density=-1)
custom_preview = CustomPreview(Geometry=merge_2, Material=material_2.PreviewMaterial)
