# Grasshopper definition rev2.gh (Grasshopper 1.0.7)
# plug-ins: Shachihoko, Kangaroo2 Components

最小変化率_半径 = Slider(0.1, range=0..1)
最大変化率_半径 = Slider(0.5, range=0..1)
seed = Slider(219, range=0..1000)
box_size = Slider(10, range=0..10)
数_最小 = Slider(50, range=0..1000)
数_最大 = Slider(100, range=0..1000)
mesh_uv = Slider(25, range=0..100)
boolean = BooleanToggle(True)
remesh = BooleanToggle(False)
savegltf = BooleanToggle(False)

construct_domain = ConstructDomain(DomainStart=数_最小, DomainEnd=数_最大)
random = Random(Range=construct_domain, Number=1, Seed=seed)
division = Division(A=box_size, B=Slider(2, range=0..10))
center_box = CenterBox(Base=PlaneXY(0, 0, 0), X=division, Y=division, Z=division)
populate_3d = Populate3D(Region=center_box, Count=random, Seed=seed)
center_box_2 = CenterBox(Base=PlaneXY(0, 0, 0), X=box_size, Y=box_size, Z=box_size)
voronoi_3d = Voronoi3D(Points=populate_3d, Box=center_box_2)  # -> Cells, Boundary
brep_closest_point = BrepClosestPoint(Point=populate_3d, Brep=voronoi_3d.Cells)  # -> Point, Normal, Distance
average = Average(Input=brep_closest_point.Distance)
multiplication = Multiplication(A=average, B=最小変化率_半径)
multiplication_2 = Multiplication(A=average, B=最大変化率_半径)
construct_domain_2 = ConstructDomain(DomainStart=multiplication, DomainEnd=multiplication_2)
random_2 = Random(Range=construct_domain_2, Number=random, Seed=seed)
数_最小_2 = Slider(0, range=0..1000)
数_最大_2 = Slider(1000, range=0..1000)
subtraction = Subtraction(A=brep_closest_point.Distance, B=random_2)
construct_domain_3 = ConstructDomain(DomainStart=数_最小_2, DomainEnd=数_最大_2)
random_3 = Random(Range=construct_domain_3, Number=Slider(3, range=0..10), Seed=seed)
number_slider = Slider(1, range=0..1)
construct_domain_4 = ConstructDomain(DomainStart=Slider(0, range=0..1), DomainEnd=Slider(1, range=0..1))
mesh_sphere = MeshSphere(Base=populate_3d, Radius=subtraction, UCount=mesh_uv, VCount=expr("x*2", mesh_uv))
mesh_box = MeshBox(Base=center_box, XCount=mesh_uv, YCount=mesh_uv, ZCount=mesh_uv)
random_4 = Random(Range=construct_domain_4, Number=random, Seed=random_3)  # -> simplify(Random)
stream_filter = StreamFilter(Gate=boolean, Stream1=mesh_sphere)
clash = Clash(FirstSet=mesh_box, SecondSet=graft(stream_filter), Distance=0, ResultLimit=100)  # -> flatten(ClashCount), ClashPoints, ClashRadii, FirstIndex, SecondIndex
explode_tree = ExplodeTree(Data=random_4)  # -> Branch0, Branch1, Branch2
dispatch = Dispatch(List=mesh_sphere, DispatchPattern=clash.ClashCount)  # -> ListA, ListB
materialparam = MaterialParam(
    XComponent=explode_tree.Branch0,
    YComponent=explode_tree.Branch1,
    ZComponent=explode_tree.Branch2,
    WComponent=Slider(0.75, range=0..1),
    ParamType=0)
materialparam_2 = MaterialParam(
    XComponent=explode_tree.Branch0,
    YComponent=explode_tree.Branch1,
    ZComponent=explode_tree.Branch2,
    WComponent=Slider(0, range=0..1),
    ParamType=0)
materialparam_3 = MaterialParam(XComponent=Slider(0.25, range=0..1), YComponent=Slider(0.25, range=0..1), ZComponent=0, WComponent=0, ParamType=0)
mesh_intersection = MeshIntersection(MeshesA=mesh_box, MeshesB=dispatch.ListA)
material = Material(Diffuse=materialparam_2, SpecularGlossiness=materialparam, ShaderType=1)
material_2 = Material(BaseColor=materialparam_2, MetallicRoughness=materialparam_3, ShaderType=0)
merge = Merge(Data1=dispatch.ListB, Data2=mesh_intersection)
number_slider_2 = Slider(0.25, range=0..1)
number_slider_3 = Slider(1, range=0..1)
stream_filter_2 = StreamFilter(Gate=remesh, Stream1=merge)
triremesh = TriRemesh(Geometry=stream_filter_2, Sharp=Toggle(True), Iterations=25)  # -> Triangulation, Dual, Creases
colour_rgb_f = ColourRGBF(Alpha=number_slider_3, Red=explode_tree.Branch0, Green=explode_tree.Branch1, Blue=explode_tree.Branch2)
colour_rgb_f_2 = ColourRGBF(Alpha=number_slider_3, Red=number_slider_2, Green=number_slider_2, Blue=number_slider_2)
stream_filter_3 = StreamFilter(Gate=remesh, Stream0=merge, Stream1=triremesh.Dual)
samevaluetree = SameValueTree(Value=Slider(0.1, range=0..1), BasedTree=colour_rgb_f)
samevaluetree_2 = SameValueTree(Value=Slider(0, range=0..1), BasedTree=colour_rgb_f)
unflatten_tree = UnflattenTree(Tree=material, Guide=flatten(stream_filter_3))  # -> simplify(graft(Tree))
graft_tree = GraftTree(Tree=stream_filter_3, IncludeEmptyLists=True, IncludeNullItems=True)  # -> simplify(graft(Tree))
material_3 = Material(
    Diffuse=colour_rgb_f,
    Specular=colour_rgb_f,
    Ambient=colour_rgb_f_2,
    Transparency=0,
    Reflectivity=samevaluetree,
    Smoothness=samevaluetree_2)  # -> PreviewMaterial, RenderMaterial
export = Export(Mesh=graft_tree, Material=unflatten_tree, FolderPath="D:\デスクトップ", FileName="model", Switch=savegltf)
brep_wireframe = BrepWireframe(Brep=center_box, Density=-1)
custom_preview = CustomPreview(Geometry=stream_filter_3, Material=material_3.PreviewMaterial)
